# Grasshopper definition test_ghx.ghx (Grasshopper 1.0.7)

series = Series(Start=0, Step=1, Count=10)

sph = Sphere(Base=PlaneXY(0, 0, 0), Radius=Slider(9, range=0..10))
X = UnitX(Factor=series)
move = Move(Geometry=sph, Motion=X)  # -> Geometry, Transform
